# Grasshopper definition ClayPrinting-DFG.gh (Grasshopper 1.0.7)
# plug-ins: Pufferfish

z_layer = Slider(0.03, range=0.01..1)
base_divs = Slider(44, range=10..100)
density_mul = Slider(1, range=1..10)
mesh = Mesh(<mesh referenced from the Rhino model>)

# ---- group: Contour method
kuka_path_v1 = CSharpScript(m=mesh, dZ=z_layer, resolution=base_divs)  # -> out, toolPath, misc; inputs m: Mesh, dZ: Double, resolution: Int32
# ---------- kuka_path_v1: C# ----------
    //main vars
    Plane[] intPlanes = new Plane[resolution];
    Curve[] intCurves = new Curve[resolution];

    //base info
    Point3d[] bbox = m.GetBoundingBox(false).GetCorners();
    Plane bPlane = new Plane(new Point3d(bbox[0].X, bbox[0].Y, bbox[0].Z + dZ), new Vector3d(1, 0, 0), new Vector3d(0, 1, 0));
    Polyline bCurve = Rhino.Geometry.Intersect.Intersection.MeshPlane(m, bPlane)[0];

    //doing this here for reasons
    int zDivs = (int) ((bbox[7].Z - bbox[0].Z) / dZ);
    Point3d[,] intPoints = new Point3d[resolution, zDivs];

    //divide base curve, get normal vectors on curve
    Point3d[] baseDivs;
    bCurve.ToPolylineCurve().DivideByCount(resolution, true, out baseDivs); //origin points
    double[] bCrvParams = bCurve.ToPolylineCurve().DivideByCount(resolution, true);
    Vector3d[] curvature = new Vector3d[bCrvParams.Length];

    for (int i = 0; i < resolution; i++)
    {
      //getting tangent curves
      curvature[i] = bCurve.ToPolylineCurve().TangentAt(bCrvParams[i]);

      //creating plane array, lets get weird
      intPlanes[i] = new Plane(baseDivs[i], curvature[i]);

      //use normal planes to construct ZCurves, find closest to pt, discard others
      Polyline[] intPCurves = Rhino.Geometry.Intersect.Intersection.MeshPlane(m, intPlanes[i]);
      int bestIndex = 0;
      for (int j = 1; j < intPCurves.Length; j++)
      {
        //MAKE SURE BOTTOM OF MESH IS PLANAR OR THIS PART ACTS VERY STRANGE
        Double distNsub = baseDivs[i].DistanceTo(intPCurves[j - 1].ClosestPoint(bCurve.CenterPoint()));
        Double distN = baseDivs[i].DistanceTo(intPCurves[j].ClosestPoint(bCurve.CenterPoint()));

        if (distN <= distNsub)
        {
          bestIndex = j;
        }
      }
      intCurves[i] = intPCurves[bestIndex].ToPolylineCurve();

      //build pt matrix, div Z curves
      Point3d[] intPTemp;
      intCurves[i].DivideByCount(zDivs, true, out intPTemp);
      for (int j = 0; j < zDivs; j++)
      {
        intPoints[i, j] = intPTemp[j];
      }
    }

    //reconfigure point matrix to arrayList for whatever reason, I guess
    var toolPts = new ArrayList();
    for (int i = 0; i < zDivs; i++)
    {
      for (int j = 0; j < resolution; j++)
      {
        toolPts.Add(intPoints[j, i]);
      }
    }

    //output
    toolPts.Reverse();
    toolPath = toolPts;

    //build optional curves bc lazy
    var toolCrv = new ArrayList();
    for (int i = 0; i < zDivs; i++)
    {
      Point3d[] ptTemp = new Point3d[resolution];

      for (int j = 0; j < resolution; j++)
      {
        ptTemp[j] = intPoints[j, i];
      }

      toolCrv.Add(Curve.CreateInterpolatedCurve(ptTemp, 3));
    }
    misc = toolCrv;
# ---------- end kuka_path_v1 ----------
crv = Curve(kuka_path_v1.misc)
clscrv = CloseCurve(Curve=crv, CloseType=2, Bulge=0.5, Tolerance=0)  # -> Closed, R
pipe = Pipe(Curve=clscrv.Closed, Radius=0.01, Caps=0)

# ---- group: Spiral method
# v1 - contour-esque divisions with "step"
# 
# v2 - "spiral" path offset per Z length
# 
# Both utilize creating planes at divisions along the base and intersecting these with the mesh normal to the base curve at each point
# 
# Z Layer = "thickness" of each pass, based on tallest pt
# Base divs = how many times the base curves gets divided
# 
# -dfg 2021
kuka_path_v2 = CSharpScript(m=mesh, dZ=z_layer, resolution=base_divs, smoothF=density_mul)  # -> out, toolPath, misc; inputs m: Mesh, dZ: Double, resolution: Int32, smoothF: Int32; disabled
# ---------- kuka_path_v2: C# ----------
    //main vars
    Plane[] intPlanes = new Plane[resolution];
    Curve[] intCurves = new Curve[resolution];
    var toolPts = new ArrayList();
    Interval[] ds = new Interval[resolution];

    //base info
    Point3d[] bbox = m.GetBoundingBox(false).GetCorners();
    Plane bPlane = new Plane(new Point3d(bbox[0].X, bbox[0].Y, bbox[0].Z + dZ), new Vector3d(1, 0, 0), new Vector3d(0, 1, 0));
    Polyline bCurve = Rhino.Geometry.Intersect.Intersection.MeshPlane(m, bPlane)[0];

    //doing this here for reasons
    int zDivs = (int) ((bbox[7].Z - bbox[0].Z) / dZ);
    Point3d[,] intPoints = new Point3d[resolution, zDivs];

    //divide base curve, get normal vectors on curve
    Point3d[] baseDivs;
    bCurve.ToPolylineCurve().DivideByCount(resolution, true, out baseDivs); //origin points
    double[] bCrvParams = bCurve.ToPolylineCurve().DivideByCount(resolution, true);
    Vector3d[] curvature = new Vector3d[bCrvParams.Length];

    for (int i = 0; i < resolution; i++)
    {
      //getting tangent curves
      curvature[i] = bCurve.ToPolylineCurve().TangentAt(bCrvParams[i]);

      //creating plane array, lets get weird
      intPlanes[i] = new Plane(baseDivs[i], curvature[i]); //kind of surprised this worked

      //use normal planes to construct ZCurves, find closest to pt, discard others
      Polyline[] intPCurves = Rhino.Geometry.Intersect.Intersection.MeshPlane(m, intPlanes[i]);
      int bestIndex = 0;
      for (int j = 1; j < intPCurves.Length; j++)
      {
        //MAKE SURE BOTTOM OF MESH IS PLANAR OR THIS PART ACTS VERY STRANGE
        Double distNsub = baseDivs[i].DistanceTo(intPCurves[j - 1].ClosestPoint(bCurve.CenterPoint()));
        Double distN = baseDivs[i].DistanceTo(intPCurves[j].ClosestPoint(bCurve.CenterPoint()));

        //check for closest curve fit
        if (distN <= distNsub)
        {
          bestIndex = j;
        }
      }

      intCurves[i] = intPCurves[bestIndex].ToPolylineCurve();

      //build curve domain list
      ds[i] = intCurves[i].Domain;
    }

    //build the big ole spiral
    for (int i = 0; i < zDivs * resolution * smoothF; i++)
    {
      double perc = (double) i / (zDivs * resolution * smoothF);
      toolPts.Add(intCurves[i % resolution].PointAt(perc * ds[i % resolution].Length));
    }

    //output
    misc = ds;
    toolPts.Reverse();
    toolPath = toolPts;
# ---------- end kuka_path_v2 ----------
intcrv = Interpolate(Vertices=kuka_path_v2.toolPath, Degree=3, Periodic=False, KnotStyle=0)  # -> Curve, Length, Domain; disabled
pipe_2 = Pipe(Curve=intcrv.Curve, Radius=0.01, Caps=0)  # disabled
