# Grasshopper definition spider_sys.gh (Grasshopper 1.0.7)
# plug-ins: Kangaroo2 Components

mesh = Mesh([<mesh referenced from the Rhino model> x3])
brep = Brep([<brep referenced from the Rhino model> x3])
crv = Curve([<curve referenced from the Rhino model> x423])
number_slider = Slider(0.2, range=0.01..5)

crv_intersect = CSharpScript(crvs=crv, t=number_slider)  # -> out, intPts; inputs crvs: list of Curve, t: Double
# ---------- crv_intersect: C# ----------
    var ptList = new ArrayList();
    Point3d ptTempThis;
    Point3d ptTempThat;
    Curve testCrv;

    for (int i = 0; i < crvs.Capacity; i++)
    {
      testCrv = crvs[i];
      for (int j = 0; j < crvs.Capacity; j++)
      {
        if (testCrv.ClosestPoints(crvs[j], out ptTempThis, out ptTempThat))
        {
          if (ptTempThis.DistanceTo(ptTempThat) < t)
          {
            ptList.Add(Point3d.Add(ptTempThis, ptTempThat) / 2);
          }
        }
      }
    }
    
    intPts = ptList;
# ---------- end crv_intersect ----------
multiplication = Multiplication(A=number_slider, B=5)
mjoin = MeshJoin(Meshes=mesh)
duppt = RemoveDuplicatePts(Points=crv_intersect.intPts, Tolerance=multiplication)
mesh_cp = CSharpScript(targetMesh=mjoin, pts=duppt)  # -> out, gridPts, vects; inputs targetMesh: Mesh, pts: list of Point3d
# ---------- mesh_cp: C# ----------
    var ptsOnMesh = new ArrayList();
    var dirs = new ArrayList();

    foreach (Point3d p in pts)
    {
      Point3d ptOnMesh = targetMesh.ClosestPoint(p);
      ptsOnMesh.Add(ptOnMesh);
      Vector3d vec = Point3d.Subtract(p, ptOnMesh);
      dirs.Add(vec / vec.Length);
    }

    gridPts = ptsOnMesh;
    vects = dirs;
# ---------- end mesh_cp ----------
spider_generator = CSharpScript(
    srfMesh=mjoin,
    pts=mesh_cp.gridPts,
    vects=mesh_cp.vects,
    radHub=Slider(0.3, range=0.1..2),
    radArms=Slider(0.1, range=0.1..2),
    lenArms=Slider(1, range=0.1..2),
    searchDist=Slider(7.5, range=1..20))  # -> out, hubs, arms, misc; inputs srfMesh: Mesh, pts: list of Point3d, vects: list of Vector3d, radHub: Double, radArms: Double, lenArms: Double, searchDist: Double
# ---------- spider_generator: C# ----------
    // vars
    Circle[] circs = new Circle[pts.Capacity];
    Plane[] plns = new Plane[pts.Capacity];
    ArrayList[] nearPts = new ArrayList[pts.Capacity]; //holy shit an array of lists, forgive me RAM
    String[] stOut = new String[pts.Capacity];
    
    
    
    var hubList = new ArrayList();
    var armList = new ArrayList();
    
    
    // hub geo
    // circles on each point w/plane for orientation
    for (int i = 0; i < pts.Capacity; i++)
    {
      plns[i] = new Plane(Point3d.Subtract(pts[i], -vects[i] / 16), vects[i]);
      circs[i] = new Circle(plns[i], radHub);
      Cylinder c = new Cylinder(circs[i], vects[i].Length / 8);
      hubList.Add(Mesh.CreateFromCylinder(c, 1, 12));
    }
    
    
    // arm geo

    // arm from grid to glass
    for (int i = 0; i < pts.Capacity; i++)
    {
      Interval dXY = new Interval(radHub / -10, radHub / 10);
      Box bt = new Box(plns[i], dXY, dXY, new Interval(0, (15 * vects[i].Length) / 16));
      armList.Add(Mesh.CreateFromBox(bt, 1, 1, 1));
    }
    
    // point search - exp
    /*
    for (int i = 0; i < pts.Capacity; i++)
    {
      nearPts[i] = new ArrayList();
      for (int j = 0; j < pts.Capacity; j++)
      {
        double ptDist = pts[i].DistanceTo(pts[j]);
        if (ptDist < searchDist && ptDist > (searchDist / 2))
        {
          nearPts[i].Add(pts[j]);
        }
      }
      
      if (nearPts[i].Capacity > 2 && nearPts[i].Capacity <= 6)
      {
        for (int j = 0; j < nearPts[i].Count - 1; j++)
        {
          
          Point3d pt1 = (Point3d) nearPts[i][j];
          Point3d pt2 = (Point3d) nearPts[i][j + 1];
          Vector3d toPt1 = new Vector3d(Point3d.Subtract(pt1, pts[i]));
          Vector3d toPt2 = new Vector3d(Point3d.Subtract(pt2, pts[i]));
          Vector3d vAvg = Vector3d.Add(toPt1, toPt2);
          vAvg = vAvg / vAvg.Length;
          armList.Add(getCyl(pts[i] + (vAvg * lenArms), vects[i], radArms, radArms / 10));
        }
      }
      else
      {
        stOut[i] = "useless result at index " + i;
      }
      */
    //}
    
    
    
    hubs = hubList;   
    arms = armList;
    misc = stOut;
# ---------- spider_generator: C# additional code ----------
  public Mesh getCyl(Point3d p, Vector3d n, double rad, double depth)
  {
    Plane thisPlane = new Plane(p, n);
    Circle thisCirc = new Circle(thisPlane, rad);
    Cylinder c = new Cylinder(thisCirc, depth);
    return Mesh.CreateFromCylinder(c, 1, 12);
  }
# ---------- end spider_generator ----------

geo = Geometry(spider_generator.hubs)
geo_2 = Geometry(spider_generator.arms)

panel = Panel(spider_generator.misc)
geo_3 = Geometry([geo, geo_2])
null = NullItem(Item=panel)  # -> NullFlags, InvalidFlags, Description
dispatch = Dispatch(List=panel, DispatchPattern=null.NullFlags)  # -> ListA, ListB
