# Grasshopper definition tetragrid_v1.gh (Grasshopper 1.0.7)

ds = Slider(12, range=4..100)
dz = Slider(12, range=4..100)
geo = Geometry(<brep referenced from the Rhino model>)
X = UnitX(Factor=dz)
Z = UnitZ(Factor=dz)
addition = Addition(A=Z, B=X)

# ---- group: Generate Tetrahedra
bbox = BoundingBox(Content=geo, Plane=PlaneXY(0, 0, 0), UnionBox=True)  # -> Box, Box_2
box_corners = BoxCorners(Box=bbox.Box)  # -> CornerA, CornerB, CornerC, CornerD, CornerE, CornerF, CornerG, CornerH

# ----
move = Move(Geometry=box_corners.CornerG, Motion=addition)  # -> Geometry, Transform

# ---- group: Generate Tetrahedra (continued)
tetra_generator = CSharpScript(lowCorner=box_corners.CornerA, highCorner=move.Geometry, dS=ds, dZ=dz)  # -> out, pyr, ptMatrix, tet, meshCt; inputs lowCorner: Point3d, highCorner: Point3d, dS: Double, dZ: Double
# ---------- tetra_generator: C# ----------
    // get grid count + dims
    double xDim = highCorner.X - lowCorner.X;
    int xCt = (int) Math.Ceiling(xDim / dS);

    double yDim = highCorner.Y - lowCorner.Y;
    int yCt = (int) Math.Ceiling(yDim / dS);

    double zDim = highCorner.Z - lowCorner.Z;
    int zCt = (int) Math.Ceiling(zDim / dZ);

    //create ptArray and new origin to account for boundary conditions
    Point3d[,,] ptArray = new Point3d[xCt + 2, yCt + 2, zCt];
    double xIe = lowCorner.X;
    double yIe = lowCorner.Y; //nIe = even z plane origin
    double zI = lowCorner.Z;

    double xIo = lowCorner.X - (dS / 2);
    double yIo = lowCorner.Y - (dS / 2); //nIo = odd z plane origin

    //generate pt matrix
    for (int z = 0; z < zCt; z++)
    {
      if (z % 2 == 0)
      {
        for (int x = 0; x < xCt; x++)
        {
          for (int y = 0; y < yCt; y++)
          {
            ptArray[x, y, z] = new Point3d(xIe + (x * dS), yIe + (y * dS), zI + (z * dZ));
          }
        }
      }
      else
      {
        for (int x = 0; x <= xCt; x++)
        {
          for (int y = 0; y <= yCt; y++)
          {
            ptArray[x, y, z] = new Point3d(xIo + (x * dS), yIo + (y * dS), zI + (z * dZ));
          }
        }
      }
    }

    //generate meshes
    var meshList = new ArrayList();
    var tetList = new ArrayList();
    for (int z = 0; z < zCt; z++)
    {
      if (z % 2 == 0)
      {
        for (int x = 0; x < xCt; x++)
        {
          for (int y = 0; y < yCt; y++)
          {
            //point-down pyramids
            if (z < zCt - 1)
            {
              Mesh pDown = new Mesh();
              pDown.Vertices.Add(ptArray[x, y, z]);             //0
              pDown.Vertices.Add(ptArray[x, y, z + 1]);         //1
              pDown.Vertices.Add(ptArray[x, y + 1, z + 1]);     //2
              pDown.Vertices.Add(ptArray[x + 1, y, z + 1]);     //3
              pDown.Vertices.Add(ptArray[x + 1, y + 1, z + 1]); //4

              pDown.Faces.AddFace(0, 1, 2);
              pDown.Faces.AddFace(0, 1, 3);
              pDown.Faces.AddFace(0, 2, 4);
              pDown.Faces.AddFace(0, 3, 4);
              pDown.Faces.AddFace(1, 3, 4, 2);

              pDown.Normals.ComputeNormals();
              pDown.UnifyNormals();
              pDown.Compact();

              meshList.Add(pDown);
            }

            //point-up pyramids
            if (z >= 1 && z <= zCt)
            {
              Print(zCt.ToString());
              Mesh pUp = new Mesh();
              pUp.Vertices.Add(ptArray[x, y, z]);             //0
              pUp.Vertices.Add(ptArray[x, y, z - 1]);         //1
              pUp.Vertices.Add(ptArray[x, y + 1, z - 1]);     //2
              pUp.Vertices.Add(ptArray[x + 1, y, z - 1]);     //3
              pUp.Vertices.Add(ptArray[x + 1, y + 1, z - 1]); //4

              pUp.Faces.AddFace(0, 1, 2);
              pUp.Faces.AddFace(0, 1, 3);
              pUp.Faces.AddFace(0, 2, 4);
              pUp.Faces.AddFace(0, 3, 4);
              pUp.Faces.AddFace(1, 3, 4, 2);

              pUp.Normals.ComputeNormals();
              pUp.UnifyNormals();
              pUp.Compact();

              meshList.Add(pUp);
            }
          }
        }
      }
      else
      {
        //interstitial pyramids
        for (int x = 0; x < xCt - 1; x++)
        {
          for (int y = 0; y < yCt - 1; y++)
          {
            //point-up pyramids
            Mesh pUp = new Mesh();
            pUp.Vertices.Add(ptArray[x + 1, y + 1, z]);     //0
            pUp.Vertices.Add(ptArray[x, y, z - 1]);         //1
            pUp.Vertices.Add(ptArray[x, y + 1, z - 1]);     //2
            pUp.Vertices.Add(ptArray[x + 1, y, z - 1]);     //3
            pUp.Vertices.Add(ptArray[x + 1, y + 1, z - 1]); //4

            pUp.Faces.AddFace(0, 1, 2);
            pUp.Faces.AddFace(0, 1, 3);
            pUp.Faces.AddFace(0, 2, 4);
            pUp.Faces.AddFace(0, 3, 4);
            pUp.Faces.AddFace(1, 3, 4, 2);

            pUp.Normals.ComputeNormals();
            pUp.UnifyNormals();
            pUp.Compact();

            meshList.Add(pUp);

            //point-down pyramids
            if (z < zCt - 1)
            {
              Mesh pDown = new Mesh();
              pDown.Vertices.Add(ptArray[x + 1, y + 1, z]);     //0
              pDown.Vertices.Add(ptArray[x, y, z + 1]);         //1
              pDown.Vertices.Add(ptArray[x, y + 1, z + 1]);     //2
              pDown.Vertices.Add(ptArray[x + 1, y, z + 1]);     //3
              pDown.Vertices.Add(ptArray[x + 1, y + 1, z + 1]); //4

              pDown.Faces.AddFace(0, 1, 2);
              pDown.Faces.AddFace(0, 1, 3);
              pDown.Faces.AddFace(0, 2, 4);
              pDown.Faces.AddFace(0, 3, 4);
              pDown.Faces.AddFace(1, 3, 4, 2);

              pDown.Normals.ComputeNormals();
              pDown.UnifyNormals();
              pDown.Compact();

              meshList.Add(pDown);
            }
          }
        }
      }
      //tetrahedra
      for (int x = 0; x < xCt - 1; x++)
      {
        for (int y = 0; y < yCt - 1; y++)
        {
          
          if (z != zCt - 1 && z % 2 == 0)
          {
            //Tet bottom line along Y
            Mesh tetY = new Mesh();
            tetY.Vertices.Add(ptArray[x, y, z]);            //0
            tetY.Vertices.Add(ptArray[x, y + 1, z]);        //1
            tetY.Vertices.Add(ptArray[x, y + 1, z + 1]);    //2
            tetY.Vertices.Add(ptArray[x + 1, y + 1, z + 1]);//3
              
            tetY.Faces.AddFace(0, 1, 2);
            tetY.Faces.AddFace(0, 1, 3);
            tetY.Faces.AddFace(0, 2, 3);
            tetY.Faces.AddFace(1, 2, 3);
              
            tetY.Normals.ComputeNormals();
            tetY.UnifyNormals();
            tetY.Compact();
              
            tetList.Add(tetY);
            
            //Tet bottom line along X
            Mesh tetX = new Mesh();
            tetX.Vertices.Add(ptArray[x, y, z]);            //0
            tetX.Vertices.Add(ptArray[x + 1, y, z]);        //1
            tetX.Vertices.Add(ptArray[x + 1, y, z + 1]);    //2
            tetX.Vertices.Add(ptArray[x + 1, y + 1, z + 1]);//3
             
            tetX.Faces.AddFace(0, 1, 2);
            tetX.Faces.AddFace(0, 1, 3);
            tetX.Faces.AddFace(0, 2, 3);
            tetX.Faces.AddFace(1, 2, 3);
              
            tetX.Normals.ComputeNormals();
            tetX.UnifyNormals();
            tetX.Compact();
              
            tetList.Add(tetX);
            
            if (z > 1)
            {
              //Tet top line along Y
              Mesh tetYT = new Mesh();
              tetYT.Vertices.Add(ptArray[x, y, z]);            //0
              tetYT.Vertices.Add(ptArray[x, y + 1, z]);        //1
              tetYT.Vertices.Add(ptArray[x, y + 1, z - 1]);    //2
              tetYT.Vertices.Add(ptArray[x + 1, y + 1, z - 1]);//3
              
              tetYT.Faces.AddFace(0, 1, 2);
              tetYT.Faces.AddFace(0, 1, 3);
              tetYT.Faces.AddFace(0, 2, 3);
              tetYT.Faces.AddFace(1, 2, 3);
              
              tetYT.Normals.ComputeNormals();
              tetYT.UnifyNormals();
              tetYT.Compact();
              
              tetList.Add(tetYT);
            
              //Tet top line along X
              Mesh tetXT = new Mesh();
              tetXT.Vertices.Add(ptArray[x, y, z]);            //0
              tetXT.Vertices.Add(ptArray[x + 1, y, z]);        //1
              tetXT.Vertices.Add(ptArray[x + 1, y, z - 1]);    //2
              tetXT.Vertices.Add(ptArray[x + 1, y + 1, z - 1]);//3
             
              tetXT.Faces.AddFace(0, 1, 2);
              tetXT.Faces.AddFace(0, 1, 3);
              tetXT.Faces.AddFace(0, 2, 3);
              tetXT.Faces.AddFace(1, 2, 3);
              
              tetXT.Normals.ComputeNormals();
              tetXT.UnifyNormals();
              tetXT.Compact();
              
              tetList.Add(tetXT);
            }
          }
        }
      }
    }

    //update outputs
    pyr = meshList;
    tet = tetList;
    ptMatrix = ptArray;
    meshCt = meshList.Count;
# ---------- tetra_generator: C# additional code ----------
  // Maybe someday I'll make that recursive method...
# ---------- end tetra_generator ----------

# ----
pt = Point(tetra_generator.ptMatrix)

# ---- group: Intersection
mesh = Mesh(tetra_generator.pyr)
mesh_2 = Mesh(tetra_generator.tet)  # disabled

# ----
mesh_3 = Mesh([mesh_2, mesh])

# ---- group: Intersection (continued)
mmx = MeshMesh(MeshA=geo, MeshB=mesh_3, UseMeshMeshFast=True)  # -> simplify(Intersections)
null = NullItem(Item=mmx)  # -> NullFlags, InvalidFlags, Description

# ----
item = ListItem(List=null.NullFlags, Index=0, Wrap=True)
not = GateNot(A=item)  # -> flatten(Result)

# ---- group: Intersection (continued)
dispatch = Dispatch(List=mesh_3, DispatchPattern=not)  # -> ListA, ListB
geo_2 = Geometry(dispatch.ListA)

# ---- group: Structure Generator
beam_thickness = Slider(0.1, range=0.1..2)
beam_width = Slider(0.1, range=0.1..2)
joint_offset = Slider(0.8, range=0..3)
joint_plate_thickness = Slider(0, range=0..3)
structure_system = CSharpScript(tetra=geo_2, bWidth=beam_width, bHeight=beam_thickness, jOffset=joint_offset, jDim=joint_plate_thickness)  # -> out, beams, joints, tCenters; inputs tetra: list of Mesh, bWidth: Double, bHeight: Double, jOffset: Double, jDim: Int32; disabled
# ---------- structure_system: C# ----------
    //vars, etc.
    int count = tetra.Capacity;
    Point3d[] cPts = new Point3d[count];
    Point3d[,,] beamPts = new Point3d[count, 8, 3]; //count # of tetra, 8 edges each tetra, 2 points for each edge + avg for non-planar
    Vector3d[,] edgeToCenter = new Vector3d[count, 8]; //count # of tetra, 4 non-planar edges to find vector to center of tetra
    var beamMeshList = new ArrayList();
    var jointMeshList = new ArrayList();

    //Get mesh edges, centers, edge to center vectors for non-planar (XY) edges, beam offset endpoints
    for (int i = 0; i < count; i++)
    {
      if (tetra[i].Vertices.Count == 5)
      {
        Point3d[] ptBucket = new Point3d[2];

        //non planar edges, ref tetra gen c# for vertex layout
        ptBucket = ptCenterOffset(new Point3d[]{tetra[i].Vertices[0], tetra[i].Vertices[1]}, jOffset);
        beamPts[i, 0, 0] = ptBucket[0];
        beamPts[i, 0, 1] = ptBucket[1];
        beamPts[i, 0, 2] = getPtAvg(new Point3d[]{beamPts[i, 0, 0], beamPts[i, 0, 1]});
        ptBucket = ptCenterOffset(new Point3d[]{tetra[i].Vertices[0], tetra[i].Vertices[2]}, jOffset);
        beamPts[i, 1, 0] = ptBucket[0];
        beamPts[i, 1, 1] = ptBucket[1];
        beamPts[i, 1, 2] = getPtAvg(new Point3d[]{beamPts[i, 1, 0], beamPts[i, 1, 1]});
        ptBucket = ptCenterOffset(new Point3d[]{tetra[i].Vertices[0], tetra[i].Vertices[3]}, jOffset);
        beamPts[i, 2, 0] = ptBucket[0];;
        beamPts[i, 2, 1] = ptBucket[1];
        beamPts[i, 2, 2] = getPtAvg(new Point3d[]{beamPts[i, 2, 0], beamPts[i, 2, 1]});
        ptBucket = ptCenterOffset(new Point3d[]{tetra[i].Vertices[0], tetra[i].Vertices[4]}, jOffset);
        beamPts[i, 3, 0] = ptBucket[0];
        beamPts[i, 3, 1] = ptBucket[1];
        beamPts[i, 3, 2] = getPtAvg(new Point3d[]{beamPts[i, 3, 0], beamPts[i, 3, 1]});

        //planar edges
        ptBucket = ptCenterOffset(new Point3d[]{tetra[i].Vertices[1], tetra[i].Vertices[2]}, jOffset);
        beamPts[i, 4, 0] = ptBucket[0];
        beamPts[i, 4, 1] = ptBucket[1];
        beamPts[i, 4, 2] = getPtAvg(new Point3d[]{beamPts[i, 4, 0], beamPts[i, 4, 1]});
        ptBucket = ptCenterOffset(new Point3d[]{tetra[i].Vertices[2], tetra[i].Vertices[4]}, jOffset);
        beamPts[i, 5, 0] = ptBucket[0];
        beamPts[i, 5, 1] = ptBucket[1];
        beamPts[i, 5, 2] = getPtAvg(new Point3d[]{beamPts[i, 5, 0], beamPts[i, 5, 1]});
        ptBucket = ptCenterOffset(new Point3d[]{tetra[i].Vertices[4], tetra[i].Vertices[3]}, jOffset);
        beamPts[i, 6, 0] = ptBucket[0];
        beamPts[i, 6, 1] = ptBucket[1];
        beamPts[i, 6, 2] = getPtAvg(new Point3d[]{beamPts[i, 6, 0], beamPts[i, 6, 1]});
        ptBucket = ptCenterOffset(new Point3d[]{tetra[i].Vertices[3], tetra[i].Vertices[1]}, jOffset);
        beamPts[i, 7, 0] = ptBucket[0];
        beamPts[i, 7, 1] = ptBucket[1];
        beamPts[i, 7, 2] = getPtAvg(new Point3d[]{beamPts[i, 7, 0], beamPts[i, 7, 1]});

        //centerpoints
        cPts[i] = getPtAvg(tetra[i].Vertices.ToPoint3dArray());

        //edge center vectors to tetrahedron center
        for (int j = 0; j < 8; j++)
        {
          edgeToCenter[i, j] = getDirection(beamPts[i, j, 2], cPts[i]);
        }
      }
    }
    //create beam meshes
    for (int i = 0; i < count; i++)
    {
      for (int j = 0; j < 8; j++)
      {

        Mesh mTemp = new Mesh();

        //construct 3 axes of beam, x perpendicular to beam, y points to center, z is parallel to beam
        Vector3d[] xyz = new Vector3d[3];

        //for non-planar members
        if (j < 4)
        {
          xyz[1] = edgeToCenter[i, j] / edgeToCenter[i, j].Length;
          xyz[2] = getDirection(beamPts[i, j, 0], beamPts[i, j, 1]);
          xyz[0] = Vector3d.CrossProduct(xyz[1], xyz[2]);

          //calc vertices from new xyz
          mTemp.Vertices.Add(Point3d.Add(beamPts[i, j, 0], 0.5 * bWidth * xyz[0]));   //0
          mTemp.Vertices.Add(Point3d.Add(beamPts[i, j, 0], -0.5 * bWidth * xyz[0]));  //1
          mTemp.Vertices.Add(Point3d.Add(beamPts[i, j, 0], Vector3d.Add(0.5 * bWidth * xyz[0], bHeight * xyz[1])));   //2
          mTemp.Vertices.Add(Point3d.Add(beamPts[i, j, 0], Vector3d.Add(-0.5 * bWidth * xyz[0], bHeight * xyz[1])));  //3
          mTemp.Vertices.Add(Point3d.Add(beamPts[i, j, 1], 0.5 * bWidth * xyz[0]));   //4
          mTemp.Vertices.Add(Point3d.Add(beamPts[i, j, 1], -0.5 * bWidth * xyz[0]));  //5
          mTemp.Vertices.Add(Point3d.Add(beamPts[i, j, 1], Vector3d.Add(0.5 * bWidth * xyz[0], bHeight * xyz[1])));   //6
          mTemp.Vertices.Add(Point3d.Add(beamPts[i, j, 1], Vector3d.Add(-0.5 * bWidth * xyz[0], bHeight * xyz[1])));  //7
        }
          //planar beams (no parallel comp)
        else
        {
          //beam along Y axis
          if (beamPts[i, j, 0].Y == beamPts[i, j, 1].Y)
          {
            xyz[0] = new Vector3d(0, edgeToCenter[i, j].Y, 0);  //discard x, z
            xyz[0] = xyz[0] / xyz[0].Length;                    //unitize +/- y
          }
            //beam along X axis
          else
          {
            xyz[0] = new Vector3d(edgeToCenter[i, j].X, 0, 0);  //discard y, z
            xyz[0] = xyz[0] / xyz[0].Length;                    //unitize +/- x
          }

          //get Z comp
          if (cPts[i].Z > beamPts[i, j, 0].Z){
            xyz[2] = new Vector3d(0, 0, 1);
          }
          else{
            xyz[2] = new Vector3d(0, 0, -1);
          }

          //calc vertices from new xyz, x or y is index 0 in this case: too lazy to make new var
          Print(xyz[0].ToString() + xyz[2].ToString());
          mTemp.Vertices.Add(Point3d.Add(beamPts[i, j, 0], bWidth * xyz[0]));                                   //0
          mTemp.Vertices.Add(beamPts[i, j, 0]);                                                                 //1
          mTemp.Vertices.Add(Point3d.Add(beamPts[i, j, 0], Vector3d.Add(bWidth * xyz[0], bHeight * xyz[2])));   //2
          mTemp.Vertices.Add(Point3d.Add(beamPts[i, j, 0], bHeight * xyz[2]));                                  //3
          mTemp.Vertices.Add(Point3d.Add(beamPts[i, j, 1], bWidth * xyz[0]));                                   //4
          mTemp.Vertices.Add(beamPts[i, j, 1]);                                                                 //5
          mTemp.Vertices.Add(Point3d.Add(beamPts[i, j, 1], Vector3d.Add(bWidth * xyz[0], bHeight * xyz[2])));   //6
          mTemp.Vertices.Add(Point3d.Add(beamPts[i, j, 1], bHeight * xyz[2]));                                  //7
        }

        //assign faces
        mTemp.Faces.AddFace(0, 1, 5, 4);
        mTemp.Faces.AddFace(0, 4, 6, 2);
        mTemp.Faces.AddFace(2, 6, 7, 3);
        mTemp.Faces.AddFace(3, 1, 5, 7);
        mTemp.Faces.AddFace(0, 1, 3, 2);
        mTemp.Faces.AddFace(4, 5, 7, 6);

        //correct mesh
        mTemp.Normals.ComputeNormals();
        mTemp.UnifyNormals();
        mTemp.Compact();

        //add mesh to master list
        beamMeshList.Add(mTemp);
      }
    }

    //create joint meshes
    for (int i = 0; i < count; i++)
    {
      for (int j = 0; j < 5; j++)
      {
        //get vertices, temp mesh
        Point3d[] verts = tetra[i].Vertices.ToPoint3dArray();
        Mesh mTemp = new Mesh();

        //5 joints per unit
        switch (j)
        {
          //point
          case 0:
            //vertices
            double zOff = bWidth * getDirection(verts[0], cPts[i]).Z;
            mTemp.Vertices.Add(verts[0].X - jOffset, verts[0].Y, verts[0].Z + zOff);
            mTemp.Vertices.Add(verts[0].X + jOffset, verts[0].Y, verts[0].Z + zOff);
            mTemp.Vertices.Add(verts[0].X, verts[0].Y - jOffset, verts[0].Z + zOff);
            mTemp.Vertices.Add(verts[0].X, verts[0].Y + jOffset, verts[0].Z + zOff);

            //faces
            mTemp.Faces.AddFace(0, 2, 1, 3);

            break;
          //x, y vertex
          case 1:
            //vertices

            //faces


            break;
          //x, y + 1 vertex
          case 2:
            //vertices

            //faces


            break;
          //x + 1, y vertex
          case 3:
            //vertices

            //faces


            break;
          //x + 1, y + 1 vertex
          case 4:
            //vertices

            //faces


            break;

        }

        //add mesh to master list
        jointMeshList.Add(mTemp);
      }
    }

    //update outputs
    tCenters = cPts;
    beams = beamMeshList;
    joints = jointMeshList;
# ---------- structure_system: C# additional code ----------
  //gets weighted average of a list of points
  public Point3d getPtAvg(Point3d[] pts)
  {
    int len = pts.GetLength(0);
    double x = 0;
    double y = 0;
    double z = 0;

    for (int i = 0; i < len; i++)
    {
      x += pts[i].X;
      y += pts[i].Y;
      z += pts[i].Z;
    }
    return new Point3d(x / len, y / len, z / len);
  }

  //2pt offset - takes 2 points and offsets them towards their average by bOffset
  public Point3d[] ptCenterOffset(Point3d[] endPts, double bOffset)
  {
    //get points
    Point3d p1 = endPts[0];
    Point3d p2 = endPts[1];
    Point3d pAvg = getPtAvg(endPts);
    double pDist = Math.Sqrt(Math.Pow(pAvg.X - p1.X, 2) + Math.Pow(pAvg.Y - p1.Y, 2) + Math.Pow(pAvg.Z - p1.Z, 2));

    //offset points
    Vector3d p1vect = new Vector3d(pAvg.X - p1.X, pAvg.Y - p1.Y, pAvg.Z - p1.Z);
    Vector3d p2vect = new Vector3d(pAvg.X - p2.X, pAvg.Y - p2.Y, pAvg.Z - p2.Z);
    p1vect = (p1vect / pDist) * bOffset;
    p2vect = (p2vect / pDist) * bOffset;

    p1 = Point3d.Add(p1, p1vect);
    p2 = Point3d.Add(p2, p2vect);

    //rebuild return array
    return new Point3d[]{p1, p2};
  }

  //gets unit vector from A to B
  public Vector3d getDirection(Point3d a, Point3d b)
  {
    Vector3d direction = new Vector3d(b.X - a.X, b.Y - a.Y, b.Z - a.Z);
    return direction / direction.Length;
  }
# ---------- end structure_system ----------

# ---- group: Bracket Generator
corner_bracket = Mesh(<mesh referenced from the Rhino model>)
point_bracket = Mesh(<mesh referenced from the Rhino model>)
bbox_2 = BoundingBox(Content=corner_bracket, Plane=PlaneXY(0, 0, 0))  # -> Box, Box_2
bbox_3 = BoundingBox(Content=point_bracket, Plane=PlaneXY(0, 0, 0))  # -> Box, Box_2
bracket_placer = CSharpScript(pyr=geo_2, cBox=bbox_2.Box, pBox=bbox_3.Box, pZOff=0.648)  # -> out, corners, points, misc; inputs pyr: list of Mesh, cBox: Box, pBox: Box, pZOff: Double
# ---------- bracket_placer: C# ----------
    Interval dimsXY = new Interval(0, cBox.X.Length);
    Interval dimsZ = new Interval(0, cBox.Z.Length);
    Interval dimPlateXY = new Interval(-pBox.X.Length / 2, pBox.X.Length / 2);
    Interval dimPlateZ = new Interval(-pBox.Z.Length, 0);
    var cornerBoxes = new ArrayList();
    var ptBoxes = new ArrayList();
    var plnList = new ArrayList();

    foreach (Mesh m in pyr)
    {
      if (m.Faces.Capacity > 4)
      {
        if (getPyrZ(m, m.Vertices[4]).Z == -1) //pt down - yes there is probably a smarter way to do this
        {
          Plane[] plns = new Plane[5];

          Plane ptPlane = new Plane(new Point3d(m.Vertices[0].X, m.Vertices[0].Y, m.Vertices[0].Z + pZOff), new Vector3d(0, 0, -1));
          Box bp = new Box(ptPlane, dimPlateXY, dimPlateXY, dimPlateZ);
          ptBoxes.Add(bp);

          for (int i = 1; i < 5; i++)
          {
            Vector3d dir = Point3d.Subtract(m.GetBoundingBox(false).Center, m.Vertices[i]);

            plns[i] = new Plane(m.Vertices[i], new Vector3d(1, 0, 0), new Vector3d(0, 1, 0));
            switch (i)
            {
              case 2:
                plns[i].Rotate(Math.PI / -2, plns[i].ZAxis);
                break;
              case 3:
                plns[i].Rotate(Math.PI / 2, plns[i].ZAxis);
                break;
              case 4:
                plns[i].Rotate(Math.PI, plns[i].ZAxis);
                break;
              default:
                break;
            }
            plns[i].Flip();
            plnList.Add(plns[i]);
            Box bt = new Box(plns[i], dimsXY, dimsXY, dimsZ);
            cornerBoxes.Add(bt);
          }

        }
        else //pt up
        {
          Plane[] plns = new Plane[5];

          Plane ptPlane = new Plane(new Point3d(m.Vertices[0].X, m.Vertices[0].Y, m.Vertices[0].Z - pZOff), new Vector3d(0, 0, 1));
          Box bp = new Box(ptPlane, dimPlateXY, dimPlateXY, dimPlateZ);
          ptBoxes.Add(bp);

          for (int i = 1; i < 5; i++)
          {
            Vector3d dir = Point3d.Subtract(m.GetBoundingBox(false).Center, m.Vertices[i]);

            plns[i] = new Plane(m.Vertices[i], new Vector3d(1, 0, 0), new Vector3d(0, 1, 0));
            switch (i)
            {
              case 2:
                plns[i].Rotate(Math.PI / -2, plns[i].ZAxis);
                break;
              case 3:
                plns[i].Rotate(Math.PI / 2, plns[i].ZAxis);
                break;
              case 4:
                plns[i].Rotate(Math.PI, plns[i].ZAxis);
                break;
              default:
                break;
            }

            plnList.Add(plns[i]);
            Box bt = new Box(plns[i], dimsXY, dimsXY, dimsZ);
            cornerBoxes.Add(bt);
          }

        }
      }
    }
    misc = plnList;
    corners = cornerBoxes;
    points = ptBoxes;
# ---------- bracket_placer: C# additional code ----------
  public Vector3d getPyrZ(Mesh m, Point3d pt)
  {
    BoundingBox b = m.GetBoundingBox(false);
    Vector3d v = Point3d.Subtract(b.Center, pt);
    v = v / v.Length;
    return new Vector3d(0, 0, Math.Round(v.Z, 0));
  }
# ---------- end bracket_placer ----------
morph = BoxMorph(Geometry=corner_bracket, Reference=bbox_2.Box, Target=bracket_placer.corners)
morph_2 = BoxMorph(Geometry=point_bracket, Reference=bbox_3.Box, Target=bracket_placer.points)

# ---- group: CLT Panel Generator
clt_curve = Curve(<curve referenced from the Rhino model>)
extrusion_depth = Slider(0.2, range=0..1)
reveal_gap = Slider(0, range=0..1)
range_from_crv = Slider(16.6, range=0.1..30)
panel_generator = CSharpScript(tetra=geo_2, crv=clt_curve, depth=extrusion_depth, gap=reveal_gap, range=range_from_crv)  # -> out, panels, panelCt; inputs tetra: list of Mesh, crv: list of Curve, depth: Double, gap: Double, range: Double; disabled
# ---------- panel_generator: C# ----------
    //init vars
    int count = tetra.Capacity;
    var mList = new ArrayList();

    Point3d faceCenter;
    Mesh mTemp;

    //for each tetra, get centerPoint of pyr face, check dist to crv in range,
    for (int i = 0; i < count; i++)
    {
      if (tetra[i].Vertices.Count == 5)
      {
        //5 faces on pyr
        for (int j = 0; j < 5; j++)
        {
          //check for base
          if (tetra[i].Faces[j].IsQuad)
          {
            faceCenter = getPtAvg(new Point3d[]{tetra[i].Vertices[tetra[i].Faces[j].A], tetra[i].Vertices[tetra[i].Faces[j].B], tetra[i].Vertices[tetra[i].Faces[j].C], tetra[i].Vertices[tetra[i].Faces[j].D]});
          }
          else
          {
            faceCenter = getPtAvg(new Point3d[]{tetra[i].Vertices[tetra[i].Faces[j].A], tetra[i].Vertices[tetra[i].Faces[j].B], tetra[i].Vertices[tetra[i].Faces[j].C]});
          }

          foreach (var c in crv)
          {
            double d; //not sure how to make things work without this mysterious double d - do not remove
            if (c.ClosestPoint(faceCenter, out d, range))
            {
              Vector3d toCenter = getDirection(faceCenter, VolumeMassProperties.Compute(tetra[i]).Centroid);
              toCenter = toCenter / toCenter.Length;

              mTemp = new Mesh();

              //get vertices w/offset of depth + reveal of gap
              mTemp.Vertices.Add(mvPoint(tetra[i].Vertices[tetra[i].Faces[j].A], faceCenter, gap));           //0
              mTemp.Vertices.Add(mvPoint(tetra[i].Vertices[tetra[i].Faces[j].B], faceCenter, gap));           //1
              mTemp.Vertices.Add(mvPoint(tetra[i].Vertices[tetra[i].Faces[j].C], faceCenter, gap));           //2
              mTemp.Vertices.Add(Point3d.Add(mvPoint(tetra[i].Vertices[tetra[i].Faces[j].A], faceCenter, gap), toCenter * -depth));     //3
              mTemp.Vertices.Add(Point3d.Add(mvPoint(tetra[i].Vertices[tetra[i].Faces[j].B], faceCenter, gap), toCenter * -depth));     //4
              mTemp.Vertices.Add(Point3d.Add(mvPoint(tetra[i].Vertices[tetra[i].Faces[j].C], faceCenter, gap), toCenter * -depth));     //5
              if (tetra[i].Faces[j].IsQuad){
                mTemp.Vertices.Add(mvPoint(tetra[i].Vertices[tetra[i].Faces[j].D], faceCenter, gap));                                   //6
                mTemp.Vertices.Add(Point3d.Add(mvPoint(tetra[i].Vertices[tetra[i].Faces[j].D], faceCenter, gap), toCenter * -depth));   //7
              }

              //build faces
              if (tetra[i].Faces[j].IsQuad){
                mTemp.Faces.AddFace(0, 1, 2, 6);
                mTemp.Faces.AddFace(0, 1, 4, 3);
                mTemp.Faces.AddFace(3, 4, 5, 7);
                mTemp.Faces.AddFace(2, 6, 7, 5);
                mTemp.Faces.AddFace(0, 6, 7, 3);
                mTemp.Faces.AddFace(1, 2, 5, 4);
              }
              else
              {
                mTemp.Faces.AddFace(0, 1, 2);
                mTemp.Faces.AddFace(0, 1, 4, 3);
                mTemp.Faces.AddFace(0, 2, 5, 3);
                mTemp.Faces.AddFace(1, 2, 5, 4);
                mTemp.Faces.AddFace(3, 4, 5);
              }

              //correct mesh
              mTemp.Normals.ComputeNormals();
              mTemp.UnifyNormals();
              mTemp.Compact();

              //add to master list
              mList.Add(mTemp);
            }
          }
        }
      }
      else
      {
        //4 faces on tetrahedron
        for (int j = 0; j < 4; j++)
        {
          faceCenter = getPtAvg(new Point3d[]{tetra[i].Vertices[tetra[i].Faces[j].A], tetra[i].Vertices[tetra[i].Faces[j].B], tetra[i].Vertices[tetra[i].Faces[j].C]});

          foreach (var c in crv)
          {
            double d; //not sure how to make things work without this mysterious double d - do not remove
            if (c.ClosestPoint(faceCenter, out d, range))
            {
              Vector3d toCenter = getDirection(faceCenter, VolumeMassProperties.Compute(tetra[i]).Centroid);
              toCenter = toCenter / toCenter.Length;

              mTemp = new Mesh();

              //get vertices w/offset of depth + reveal of gap
              mTemp.Vertices.Add(mvPoint(tetra[i].Vertices[tetra[i].Faces[j].A], faceCenter, gap));           //0
              mTemp.Vertices.Add(mvPoint(tetra[i].Vertices[tetra[i].Faces[j].B], faceCenter, gap));           //1
              mTemp.Vertices.Add(mvPoint(tetra[i].Vertices[tetra[i].Faces[j].C], faceCenter, gap));           //2
              mTemp.Vertices.Add(Point3d.Add(mvPoint(tetra[i].Vertices[tetra[i].Faces[j].A], faceCenter, gap), toCenter * -depth));     //3
              mTemp.Vertices.Add(Point3d.Add(mvPoint(tetra[i].Vertices[tetra[i].Faces[j].B], faceCenter, gap), toCenter * -depth));     //4
              mTemp.Vertices.Add(Point3d.Add(mvPoint(tetra[i].Vertices[tetra[i].Faces[j].C], faceCenter, gap), toCenter * -depth));     //5

              //build faces
              mTemp.Faces.AddFace(0, 1, 2);
              mTemp.Faces.AddFace(0, 1, 4, 3);
              mTemp.Faces.AddFace(0, 2, 5, 3);
              mTemp.Faces.AddFace(1, 2, 5, 4);
              mTemp.Faces.AddFace(3, 4, 5);

              //correct mesh
              mTemp.Normals.ComputeNormals();
              mTemp.UnifyNormals();
              mTemp.Compact();

              //add to master list
              mList.Add(mTemp);
            }
          }
        }
      }
      
    }
    //update outputs
    panelCt = mList.Capacity;
    panels = mList;
# ---------- panel_generator: C# additional code ----------
  //gets weighted average of a list of points
  public Point3d getPtAvg(Point3d[] pts)
  {
    int len = pts.GetLength(0);
    double x = 0;
    double y = 0;
    double z = 0;

    for (int i = 0; i < len; i++)
    {
      x += pts[i].X;
      y += pts[i].Y;
      z += pts[i].Z;
    }
    return new Point3d(x / len, y / len, z / len);
  }

  //gets unit vector from A to B
  public Vector3d getDirection(Point3d a, Point3d b)
  {
    Vector3d direction = new Vector3d(b.X - a.X, b.Y - a.Y, b.Z - a.Z);
    return direction / direction.Length;
  }

  //move pt A towards B by dist
  public Point3d mvPoint(Point3d A, Point3d B, double dist)
  {
    Vector3d dir = getDirection(A, B);
    return Point3d.Add(A, dir * dist);
  }
# ---------- end panel_generator ----------

# ---- group: Output Meshes
clt_panels = Mesh(panel_generator.panels)
beams = Geometry(structure_system.beams)
brackets = Geometry([morph_2, morph])

# ----
joints = Geometry(structure_system.joints)
